vi "Beamforming.gvi"   [LabVIEW Communications System Design Software 2.0.1]
inputs:
  "Num Samples": f64
  "Signal": c128[][]
  "Angles": i32 = 180
outputs:
  "Power": f64[]
  "Estimate": f64
uses:
  NI::Analysis::Generation::Ramp Pattern by Increment.gvi
  NI::Analysis::LinearAlgebra::Real Outer Product.gvi
  NI::Analysis::LinearAlgebra::Complex A x B.gvi
diagram:
  Negate(x=$Angles) -> w1
  call "Ramp Pattern by Increment.gvi"(increment=1, end=$Angles, start=w1) -> (ramp pattern=w2)
  Divide(x=w2, y=180) -> w3
  Multiply(w3, Pi) -> w4
  Sine(x=w4) -> w5
  Multiply(w5, Pi) -> w6
  Real And Imaginary To Complex(x=0, y=w6) -> w7
  Exponential(x=w7) -> w8
  Array Subset(array=$Signal, length1=$"Num Samples") -> w9
  call "Ramp Pattern by Increment.gvi"(increment=1, end=3, start=0) -> (ramp pattern=w10)
  call "Real Outer Product.gvi"(vector x=w10, vector y=w6) -> (outer product=w11)
  Real And Imaginary To Complex(x=0, y=w11) -> w12
  Exponential(x=w12) -> w13
  Transpose 2D Array(2D array=w13) -> (transposed array=w14)
  call "Complex A x B.gvi"(matrix A=w14, matrix B=w9) -> (A x B=w15)
  Absolute Value(x=w15) -> w16
  Square(x=w16) -> w17
  for {
    w18 = each element of w17
    Add Array Elements(numeric array=w18) -> (sum=w20)
    append w20 to w19
  }
  Divide(x=w19, y=$"Num Samples") -> w21
  Multiply(w21, w8) -> w22
  Absolute Value(x=w22) -> w23
  Add(1, w23) -> w24
  Logarithm Base 10(x=w24) -> w25
  $Power <- w25
  Complex To Polar(r * e^(i*theta)=w22) -> (r=w26)
  Array Max And Min(array=w26) -> (max index(es)=w27)
  Array Index(array=w22) -> (out0[w27]=w28)
  Complex To Polar(r * e^(i*theta)=w28) -> (theta=w29)
  Divide(x=w29, y=Pi) -> w30
  Inverse Sine(x=w30) -> w31
  Multiply(w31, 180) -> w32
  Divide(x=w32, y=Pi) -> w33
  $Estimate <- w33
