vi "Rx Multiple Synchronized Inputs.gvi"   [LabVIEW Communications System Design Software 2.0.1]
panel controls:
  "IQ rate [S/sec]": f64 = 1000000
  "Carrier Frequency [Hz]": f64 = 2000000000
  "Gain 0": f64 = 10
  "Active Antenna 0": string = "RX1"
  "Gain 1": f64 = 10
  "Active Antenna 1": string = "RX1"
  "Start Trigger Time": T1 = {"whole seconds"=0, "fractional seconds"=0.1}
  "Number of Samples Per Fetch": i64 = 16384
  "Timeout": f64 = 10
  "Stop": bool
  "Device IDs": "niUSRPClass" = "192.168.10.2; 192.168.10.3"
  "Sync": bool
panel indicators:
  "Actual Rx Timestamp": T1
  "Baseband Power Spectrum": T2[]
  "IQ Graph": f64[][]
  "Sync'd Signal": f64[][]
  "Phase Offset": c128
  "Estimated Azimuth": f64
types:
  T1 = cluster{"whole seconds": u64, "fractional seconds": f64}
  T2 = cluster{"f0": f64, "df": f64, "magnitude": f64[]}
uses:
  NI::Analysis::Measurement::Power Spectrum for 1 Chan (CDB).gvi
  NI::Analysis::Generation::Ramp Pattern by Increment.gvi
  NI::Analysis::LinearAlgebra::Real Outer Product.gvi
  NI::Analysis::LinearAlgebra::Complex A x B.gvi
  NI::Analysis::Statistics::Mean (CDB).gvi
diagram:
  w1 = $"Carrier Frequency [Hz]"
  call "niUSRP Open Rx Session.gvi"(device names=$"Device IDs", reset=TRUE) -> (error out=w2, session handle out=w3)
  Property Node(instance in=w3, "Enabled Channels"="0,1", error in=w2) -> (error out=w4, instance out=w5)
  # Synchronized devices must use a Start Trigger.
  call "niUSRP Configure Time Start Trigger.gvi"(session handle=w5, start trigger time=$"Start Trigger Time", error in=w4) -> (session handle out=w6, error out=w7)
  Property Node(instance in=w6, "IQ Rate"=$"IQ rate [S/sec]", "Carrier Frequency"=w1, error in=w7) -> ("IQ Rate"=w8, error out=w9, instance out=w10)
  # coerced IQ rate
  # sample period
  Reciprocal(x=w8) -> w11
  # Set the attributes common to all channels.
  # Set the attributes specific to channel 0.
  Property Node(instance in=w10, sub-item="0", "Gain"=$"Gain 0", "Active Antenna"=$"Active Antenna 0", error in=w9) -> (error out=w12, instance out=w13)
  w14 = "Mimo"  # Reference Frequency Source
  w15 = "Mimo"  # Timebase Clock Source
  # Set the attributes specific to channel 1.
  # Channel 1 must also use the same
  # reference frequency and timebase clock
  # as channel 1 (in this case synchronized
  # over the MIMO cable).
  Property Node(instance in=w13, sub-item="1", "Gain"=$"Gain 1", "Active Antenna"=$"Active Antenna 1", "Reference Frequency Source"=w14, "Timebase Clock Source"=w15, error in=w12) -> (error out=w16, instance out=w17)
  call "niUSRP Set Time.gvi"(session handle=w17, apply timestamp="Now", timestamp=T1 {all zero or empty}, error in=w16, channel list="0,1") -> (session handle out=w18, error out=w19)
  call "niUSRP Initiate.gvi"(session handle=w18, error in=w19) -> (session handle out=w20, error out=w21)
  # Set the internal
  # clocks back to
  # time 0.
  s1 = w21  # shift register
  while (iteration -> i1) {
    call "niUSRP Fetch Rx Data (2D CDB).gvi"(session handle=w20, number of samples=$"Number of Samples Per Fetch", timeout=$Timeout, error in=s1) -> (session handle out=w22, data=w23, timestamp=w24, error out=w25)
    s2 = f64[][] []  # shift register
    for {
      w26 = each element of w23
      Complex To Real Imaginary(x + iy=w26) -> (x=w27, y=w28)
      Build Array[ConcatenateInputs=True](s2, w27, w28) -> w29
      next s2 = w29
    }
    $"IQ Graph" <- s2
    Quotient And Remainder(x=i1, y=16) -> (x-y*floor(x/y)=w30)
    case (w30) {
      frame Default { }
      frame 0 {
        for {
          w31 = each element of w23
          Property Node(instance in=waveform<c128> {all zero or empty}, "Y"=w31, "dt"=w11) -> (instance out=w33)
          call "Power Spectrum for 1 Chan (CDB).gvi"(signal=w33, dB on=TRUE) -> (power spectrum=w34)
          append w34 to w32
        }
        $"Baseband Power Spectrum" <- w32
      }
    }
    $"Actual Rx Timestamp" <- w24
    Logical Or(w25, $Stop) -> w35
    Feedback Node(enable?=$Sync, input=w36) -> w37
    for {
      w38 = each element of w37
      w39 = each element of w23
      Multiply(w38, w39) -> w41
      append w41 to w40
    }
    case (w30) {
      frame 0 {
        Negate(x=90) -> w42
        call "Ramp Pattern by Increment.gvi"(increment=1, end=90, start=w42) -> (ramp pattern=w43)
        Divide(x=w43, y=180) -> w44
        Multiply(w44, Pi) -> w45
        Real And Imaginary To Complex(x=0, y=w45) -> w46
        Exponential(x=w46) -> w47
        call "Ramp Pattern by Increment.gvi"(increment=1, end=1, start=0) -> (ramp pattern=w48)
        call "Real Outer Product.gvi"(vector x=w48, vector y=w45) -> (outer product=w49)
        Real And Imaginary To Complex(x=0, y=w49) -> w50
        Exponential(x=w50) -> w51
        Transpose 2D Array(2D array=w51) -> (transposed array=w52)
        call "Complex A x B.gvi"(matrix A=w52, matrix B=w40) -> (A x B=w53)
        Absolute Value(x=w53) -> w54
        Square(x=w54) -> w55
        for {
          w56 = each element of w55
          Add Array Elements(numeric array=w56) -> (sum=w58)
          append w58 to w57
        }
        Divide(x=w57, y=$"Number of Samples Per Fetch") -> w59
        Multiply(w59, w47) -> w60
        Complex To Polar(r * e^(i*theta)=w60) -> (r=w61)
        Array Max And Min(array=w61) -> (max index(es)=w62)
        Array Index(array=w60) -> (out0[w62]=w63)
        Complex To Polar(r * e^(i*theta)=w63) -> (theta=w64)
        Divide(x=w64, y=PiTimes2) -> w65
        Multiply(w65, SpeedOfLight) -> w66
        Divide(x=w66, y=w1) -> w67
        Divide(x=w67, y=0.1667) -> w68
        Inverse Sine(x=w68) -> w69
        Multiply(w69, 180) -> w70
        Divide(x=w70, y=Pi) -> w71
        $"Estimated Azimuth" <- w71
      }
      frame Default { }
    }
    case ($Sync) {
      frame False, Default {
        w36 = w37
      }
      frame True {
        Array Size(array=w23) -> (size(s)=w72)
        Array Index(array=w72) -> (out0[0]=w73)
        for (N = w73) (iteration -> i2) {
          Array Index(array=w23) -> (out0[0, _]=w74)
          Array Index(array=w23) -> (out0[i2, _]=w75)
          Divide(x=w74, y=w75) -> w76
          call "Mean (CDB).gvi"(x=w76) -> (mean=w77)
          append w77 to w36
        }
      }
    }
    s3 = f64[][] []  # shift register
    for {
      w78 = each element of w40
      Complex To Real Imaginary(x + iy=w78) -> (x=w79, y=w80)
      Build Array[ConcatenateInputs=True](s3, w79, w80) -> w81
      next s3 = w81
    }
    $"Sync'd Signal" <- s3
    next s1 = w25
    stop if w35
  }
  call "niUSRP Abort.gvi"(session handle=w22, error in=s1) -> (session handle out=w82, error out=w83)
  call "niUSRP Close Session.gvi"(session handle=w82, error in=w83) -> (error out=w84)
  call "Simple Error Handler.gvi"(error in=w84)
