vi "Sync.gvi"   [LabVIEW Communications System Design Software 2.0.1]
inputs:
  "Sig": c128[][]
  "LPF Sig": c128[][]
outputs:
  "Sync'd Signals": c128[][]
diagram:
  Array Size(array=$"LPF Sig") -> (size(s)=w1)
  Array Index(array=w1) -> (out0[0]=w2)
  for (N = w2) (iteration -> i1) {
    Array Index(array=$"LPF Sig") -> (out0[0, _]=w4)
    Array Index(array=$"LPF Sig") -> (out0[i1, _]=w5)
    Divide(x=w4, y=w5) -> w6
    Natural Logarithm(x=w6) -> w7
    Complex To Real Imaginary(x + iy=w7) -> (y=w8)
    append w8 to w3
  }
  for (N = w2) (iteration -> i2) {
    Array Index(array=$Sig) -> (out0[i2, _]=w10)
    Real And Imaginary To Complex(x=0, y=w3) -> w11
    Exponential(x=w11) -> w12
    Array Index(array=w12) -> (out0[i2, _]=w13)
    Multiply(w10, w13) -> w14
    append w14 to w9
  }
  $"Sync'd Signals" <- w9
